# Grasshopper definition assemblages.gh (Grasshopper 0.9.76)
# plug-ins: CORE.GH, Human, HDTTreeUtils

number_size = Number(Slider(50, range=0..100))

squelette = Curve([<curve referenced from the Rhino model> x6])
sections = Curve(<curve referenced from the Rhino model>)

crv = Curve(squelette)
sections_2 = Curve(sections)
objatts = ObjectAttributes(ObjectOrAttributes=crv)  # -> Name, LayerName, LayerFullPath, Color, MaterialName, LinetypeName, GroupIndices, PlotWeight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
tsort = SortText(Keys=objatts.LayerName, Values=crv, Culture=127)  # -> Keys, Values
dcon = DeleteConsecutive(Set=tsort.Keys, Wrap=False)  # -> simplify(flatten(Set)), Count
mindex = MemberIndex(Set=dcon.Set, Member=graft(objatts.LayerName))  # -> flatten(Index), Count

joint_overlap = Number(Slider(69, range=0..100))
joint_thickness = Number(Slider(9, range=0..10))
joint_tolerance = Number(Slider(0.5, range=0..1))

area = Area(Geometry=sections_2)  # -> Area, Centroid
explode = Explode(Curve=sections_2, Recursive=True)  # -> Segments, Vertices
dist = Distance(PointA=area.Centroid, PointB=explode.Vertices)
sort = SortList(Keys=dist)  # -> Keys, ValuesA
item = ListItem(List=sort.Keys, Index=-1, Wrap=True)  # -> simplify(flatten(Item))

sections_3 = Curve(simplify(flatten(sections_2)))
sectionsindex = Integer(mindex.Index)
squelette_2 = Curve(crv)
rayons = Number(item)
item_2 = ListItem(List=rayons, Index=sectionsindex, Wrap=True)  # -> simplify(Item)
mcx = MultipleCurves(Curves=reparameterize(squelette_2))  # -> Points, IndexA, IndexB, ParamA, ParamB

# ---- group: structure data by joint
pt = Point(mcx.Points)
lng = ListLength(List=pt)
cullduppoints = RemoveDuplicatePoints(InputPoints=pt, Tolerance=0.001)  # -> OutputPoints, FirstPointIndexes
series = Series(Start=0, Step=1, Count=lng)
null = NullItem(Item=cullduppoints.FirstPointIndexes)  # -> NullFlags, InvalidFlags, Description
cull = CullPattern(List=series, CullPattern=null.NullFlags)
p_n_c = PickNChoose(Pattern=null.NullFlags, Stream0=cullduppoints.FirstPointIndexes, Stream1=series)
int = Integer(flatten(cull))
int_2 = Integer(p_n_c)
mindex_2 = MemberIndex(Set=int, Member=int_2)  # -> simplify(flatten(Index)), Count
indexes = Integer(mindex_2.Index)
graftbydata = GraftByData(InputData=pt, PathsToAssign=indexes)  # -> simplify(RestructuredData)
pt_2 = Point(simplify(graftbydata))

# ----
data = Data(mcx.IndexA)
lastitem = LastItem(data=data)
item_3 = ListItem(List=pt_2, Index=0, Wrap=True)

squelette_3 = Curve(squelette_2)
pt_3 = Point(item_3)
curvepoint = PointOnCurve(squelette_3, parameter=0.5)
points = PointList(Points=curvepoint, Size=number_size)
points_2 = PointList(Points=flatten(pt_3), Size=Slider(10, range=0..10))

graftbydata_2 = GraftByData(InputData=mcx.ParamB, PathsToAssign=indexes)  # -> simplify(RestructuredData)
graftbydata_3 = GraftByData(InputData=mcx.IndexB, PathsToAssign=indexes)  # -> simplify(RestructuredData)
graftbydata_4 = GraftByData(InputData=mcx.IndexA, PathsToAssign=indexes)  # -> simplify(RestructuredData)
graftbydata_5 = GraftByData(InputData=mcx.ParamA, PathsToAssign=indexes)  # -> simplify(RestructuredData)
data_2 = Data(lastitem)
num = Number(joint_thickness)
panel = Panel(num)

tolerance_joint = Number(joint_tolerance)
rayons_2 = Number(item_2)
squelette_4 = Curve(squelette_2)
indexa = Number(graftbydata_4)
ta = Number(graftbydata_5)
indexb = Number(graftbydata_3)
tb = Number(graftbydata_2)

addition = Addition(A=tolerance_joint, B=rayons_2)

rayons_3 = Number(addition)

num_2 = Number(ta)
item_4 = ListItem(List=squelette_4, Index=indexa, Wrap=True)
larger = LargerThan(FirstNumber=num_2, SecondNumber=0)  # -> LargerThan, OrEqualTo
equals = Equality(FirstNumber=num_2, SecondNumber=1)  # -> Equality, Inequality
eval = EvaluateCurve(Curve=reparameterize(item_4), Parameter=num_2)  # -> Point, expr("-x", Tangent), Angle
addition_2 = Addition(A=equals.Equality, B=larger.LargerThan)
subtraction = Subtraction(A=addition_2, B=1)

num_3 = Number(tb)
item_5 = ListItem(List=squelette_4, Index=indexb, Wrap=True)
larger_2 = LargerThan(FirstNumber=num_3, SecondNumber=0)  # -> LargerThan, OrEqualTo
equals_2 = Equality(FirstNumber=num_3, SecondNumber=1)  # -> Equality, Inequality
eval_2 = EvaluateCurve(Curve=reparameterize(item_5), Parameter=num_3)  # -> Point, expr("-x", Tangent), Angle
addition_3 = Addition(A=equals_2.Equality, B=larger_2.LargerThan)
subtraction_2 = Subtraction(A=addition_3, B=1)

# ---- group: trigo
multiplication = Multiplication(A=eval.Tangent, B=subtraction)
lnln = LineLine(LineA=item_4, LineB=item_5)
multiplication_2 = Multiplication(A=eval_2.Tangent, B=subtraction_2)
alpha = Angle(VectorA=multiplication, VectorB=multiplication_2, Plane=lnln)  # -> Angle, Reflex
r1 = ListItem(List=rayons_3, Index=indexa, Wrap=True)
r2 = ListItem(List=rayons_3, Index=indexb, Wrap=True)
tan = Tangent(Value=alpha.Angle)
sin = Sine(Value=alpha.Angle)

# ---- group: d1
division = Division(A=r2, B=sin)
division_2 = Division(A=r1, B=tan)
addition_4 = Addition(A=division_2, B=division)
abs = Absolute(Value=addition_4)

# ---- group: d2
division_3 = Division(A=r2, B=tan)
division_4 = Division(A=r1, B=sin)
addition_5 = Addition(A=division_3, B=division_4)
abs_2 = Absolute(Value=addition_5)

# ----
amp = Amplitude(Vector=multiplication_2, Amplitude=abs_2)
amp_2 = Amplitude(Vector=multiplication, Amplitude=abs)
move = Move(Geometry=eval_2.Point, Motion=amp_2)  # -> Geometry, Transform
move_2 = Move(Geometry=eval_2.Point, Motion=amp)  # -> Geometry, Transform
crv_cp = CurveClosestPoint(Point=move_2.Geometry, Curve=item_5)  # -> Point, Parameter, Distance
crv_cp_2 = CurveClosestPoint(Point=move.Geometry, Curve=item_4)  # -> Point, Parameter, Distance
graftbydata_6 = GraftByData(InputData=crv_cp_2.Point, PathsToAssign=indexa)  # -> simplify(RestructuredData)
graftbydata_7 = GraftByData(InputData=crv_cp.Point, PathsToAssign=indexb)  # -> simplify(RestructuredData)

joints_intersected = Point([graftbydata_7, graftbydata_6])
nodes = Point(graft(pt_2))
joint_overlap_2 = Number(joint_overlap)
path_mapper = PathMapper(nodes, source="{A;B}(i)", target="{A}")
dist_2 = Distance(PointA=nodes, PointB=joints_intersected)
sort_2 = SortList(Keys=dist_2, ValuesA=joints_intersected)  # -> Keys, reverse(ValuesA)
item_6 = ListItem(List=path_mapper, Index=0, Wrap=True)
item_7 = ListItem(List=sort_2.ValuesA, Index=0, Wrap=True)
path_mapper_2 = PathMapper(item_7, source="{A;B}(i)", target="{A}")
vec2pt = Vector2Pt(PointA=item_6, PointB=path_mapper_2, Unitize=False)  # -> Vector, Length
amp_3 = Amplitude(Vector=unitize(vec2pt.Vector), Amplitude=joint_overlap_2)
pl = PlaneNormal(Origin=path_mapper_2, ZAxis=vec2pt.Vector)
pl_2 = PlaneNormal(Origin=item_6, ZAxis=vec2pt.Vector)
addition_6 = Addition(A=vec2pt.Vector, B=amp_3)
move_3 = Move(Geometry=pl_2, Motion=addition_6)  # -> Geometry, Transform

panel_2 = Panel(indexa)
panel_3 = Panel(joints_intersected)
dam = DataDam(DataA=pl_2, DataB=pl, DataC=move_3.Geometry, BufferDelay=10000000, BufferMode=1)  # -> DataA, DataB, DataC

pln = Plane(dam.DataB)
pln_2 = Plane(dam.DataC)
pln_3 = Plane(dam.DataA)
section = Curve(sections_3)
rayons_4 = Number(rayons)

orient = Orient(Geometry=section, Source=section, Target=pln_3)  # -> graft(Geometry), Transform
orient_2 = Orient(Geometry=section, Source=section, Target=pln)  # -> graft(Geometry), Transform
orient_3 = Orient(Geometry=section, Source=section, Target=pln_2)  # -> graft(Geometry), Transform
addition_7 = Addition(A=num, B=rayons_4)
offset = Offset(Curve=orient_3.Geometry, Distance=num, Plane=graft(pln_2), Corners=1)
offset_2 = Offset(Curve=orient.Geometry, Distance=num, Plane=graft(pln), Corners=1)
loft = Loft(
    Curves=[orient_2.Geometry, orient_3.Geometry],
    Options={Adjust=False, Closed=False, LoftEnds=0, LoftSimp=0, LoftType=0, Rebuild=10, Refit=0.01})
sph = Sphere(Base=pln_3, Radius=addition_7)
loft_2 = Loft(
    Curves=[offset_2, offset],
    Options={Adjust=False, Closed=False, LoftEnds=0, LoftSimp=0, LoftType=0, Rebuild=10, Refit=0.01})
cap = CapHoles(Brep=loft_2)  # -> simplify(Brep)
cap_2 = CapHoles(Brep=loft)
item_8 = ListItem(List=sph, Index=0, Wrap=True)
path_mapper_3 = PathMapper(cap_2, source="{A;B}(i)", target="{A}")
path_mapper_4 = PathMapper(cap, source="{A;B}(i)", target="{A}")
sunion = SolidUnion(Breps=[item_8, path_mapper_4])
panel_4 = Panel(path_mapper_3)
sdiff = SolidDifference(BrepsA=sunion, BrepsB=path_mapper_3)  # -> simplify(Result)

# ==== cluster LastItem
data = ClusterInput()
data_2 = Data(data)
item = ListItem(List=data_2, Index=-1, Wrap=True)
data_3 = Data(item)
data_4 = ClusterOutput(data_3)
